# Grasshopper definition Hops.gh (Grasshopper 1.0.7)
# plug-ins: Hops, Wombat

Y = Data([36.29287099, 45.09542952, -46.10201195, -37.29945342])
X = Data([-43.78647637, 79.60457781, 40.42267925, -76.24078068])
comb = FilePath("D:\IAAC\04_Thesis\backend-copy\assets\FloorPlanGenerator_Combined.gh")
hops = Hops(
    _Path=comb,
    LineType="Polygon",
    Corridor="1",
    Levels="2",
    X=X,
    Y=Y,
    CacheResultsInMemory=True,
    CacheSolveResults=True,
    RemoteDefinitionLocation="D:\IAAC\04_Thesis\backend-copy\assets\FloorPlanGenerator_Combined.gh",
    RemoteSolveVersion=(0, 1, 0),
    ShowInput_Enabled=False,
    ShowInput_Path=True,
    SynchronousSolve=True)  # -> Output, X, Y

# ----
# JSONhops.txt
toggle = BooleanToggle(False)
path = FilePath("D:\IAAC\04_Thesis\CloudBasedGraphMachineLearningFrontend\backup\JSONhops.txt")
writetxt = WriteToTextFile(Run=toggle, TextToWrite=hops.Output, FilePath=path, Append=False, NewOnly=False)
