# Grasshopper definition loadJSON.gh (Grasshopper 1.0.7)
# plug-ins: ShapeDiverForGrasshopper, Pufferfish

# FRONTEND
# JSONfrontend.txt
# JSONhops.txt
sddp = ShapeDiverDocumentPayload({AbsoluteTolerance=0, AngleTolerance=0, DistanceDisplayPrecision=0, GltfVersion="Gltf2", GrasshopperVersion="1.0.0007", InputGroups="{}", OutputGroups="{}", RelativeTolerance=0, RhinoVersion="7.32.23221.10241", UnitSystem=0, VersionCreated="1.14.0.0", VersionSaved="1.14.0.0"})
# BACKEND
# JSONbackend.txt
# JSONfromGH.txt
list = ValueList({"JSONBackend": 0, "JSONfromGH": 1}, selected="JSONBackend")
list_2 = ValueList({"JSONFrontend": 0, "JSONhops": 1}, selected="JSONFrontend")
path = FilePath("D:\IAAC\04_Thesis\CloudBasedGraphMachineLearningFrontend\backup\JSONbackend.txt")
path_2 = FilePath("D:\IAAC\04_Thesis\CloudBasedGraphMachineLearningFrontend\backup\JSONfromGH.txt")
path_3 = FilePath("D:\IAAC\04_Thesis\CloudBasedGraphMachineLearningFrontend\backup\JSONfrontend.txt")
path_4 = FilePath("D:\IAAC\04_Thesis\CloudBasedGraphMachineLearningFrontend\backup\JSONfrontend.txt")

filter = StreamFilter(Gate=list_2, Stream0=path_3, Stream1=path_4)
file = ReadFile(File=filter, PerLineParse=False)
parsejson = ParseJSON(JSON=file)
accessjson = AccessJSON(Object=parsejson, AddressString="geometry")
accessjson_2 = AccessJSON(Object=accessjson, AddressString="coordinates")
accessjson_3 = AccessJSON(Object=accessjson, AddressString="type")
panel = Panel(accessjson_2)
expression = Expression(x=accessjson_3, Expression="x=\"Polygon\"")
item = ListItem(List=accessjson_2, Index=0, Wrap=True)  # -> Item, Item1, Item2
pt = ConstructPoint(XCoordinate=item.Item, YCoordinate=item.Item1, ZCoordinate=0)
pline = PolyLine(Vertices=flatten(pt), Closed=expression)
crv = Curve(pline)
preview = CustomPreview(Geometry=crv, Material=ColourSwatch(SwatchColor=RGB(247, 76, 0)))

filter_2 = StreamFilter(Gate=list, Stream0=path, Stream1=path_2)
file_2 = ReadFile(File=filter_2, PerLineParse=False)
parsejson_2 = ParseJSON(JSON=file_2)
accessjson_4 = AccessJSON(Object=parsejson_2, AddressString="features")
accessjson_5 = AccessJSON(Object=accessjson_4, AddressString="node")
accessjson_6 = AccessJSON(Object=accessjson_4, AddressString="edge")
null = NullItem(Item=accessjson_6)  # -> NullFlags, InvalidFlags, Description
accessjson_7 = AccessJSON(Object=accessjson_5, AddressString="properties")
dispdexs = DispatchIndices(List=accessjson_6, Indices=null.NullFlags)  # -> AtI, NotI
accessjson_8 = AccessJSON(Object=accessjson_7, AddressString="metadata")
accessjson_9 = AccessJSON(Object=dispdexs.AtI, AddressString="properties")
accessjson_10 = AccessJSON(Object=accessjson_8, AddressString="geometry")
accessjson_11 = AccessJSON(Object=accessjson_10, AddressString="coordinates")
accessjson_12 = AccessJSON(Object=accessjson_9, AddressString="source")
accessjson_13 = AccessJSON(Object=accessjson_9, AddressString="target")
item_2 = ListItem(List=accessjson_11, Index=0, Wrap=True)  # -> Item, Item1, Item2
pt_2 = ConstructPoint(XCoordinate=item_2.Item, YCoordinate=item_2.Item1, ZCoordinate=item_2.Item2)
item_3 = ListItem(List=flatten(pt_2), Index=accessjson_12, Wrap=True)
item_4 = ListItem(List=flatten(pt_2), Index=accessjson_13, Wrap=True)
ln = Line(StartPoint=item_3, EndPoint=item_4)
pt_3 = Point(pt_2)
preview_2 = CustomPreview(Geometry=ln, Material=ColourSwatch(SwatchColor=RGB(47, 33, 197)))

pts = Data(Tree({0;0;0}: [-0.1118479316, -75.38550593], {0;0;1}: [74.60257041, -6.934571762], {0;0;2}: [6.151636241, 53.0159196], {0;0;3}: [-80.64235872, 29.30415809]))
